% Simulink data dictionary UAM_data.sldd

SensorAAFiltNum = 4386000
SensorAAFiltDen = [1 2960 4386000]
FSState = flightState.Hover
R_WAYPOINTTRANSITION = 1
R_LOOKAHEAD = 5

AAC = Simulink.Bus()
  airspeed: double
  altitude: double
  course: double
  L1: double
  climbrate: double

HoverMission = struct(mode=uint8(0), position=[0; 0; 0], params=[0; 0; 0; 0])
UAVSampleTime = 0.02
zGround = 0

FixedWingCommandBus = Simulink.Bus()
  roll: double
  pitch: double
  yaw: double
  airspeed: double

HoverSPBus = Simulink.Bus()
  X: double
  Y: double
  Z: double
  Yaw: double

innerLoopCmdsBus = Simulink.Bus()
  LAP: double[3 1]
  HeadingCmd: double
  YawCmd: double

FlightModeType = enum(DefaultValue="Manual")
  Manual = 0
  Auto = 1
  Emergecny = 2

ReferenceFilterNum = 0.04877
ReferenceFilterDen = [1 -0.9512]
ControlSampleTime = 0.005

FixedWingCtrlBus = Simulink.Bus()
  dA: double
  dE: double
  dR: double
  dT: double

Cruise_a = 1

RotorParameters = Simulink.Bus()
  w1: double
  w2: double
  w3: double
  w4: double
  c1: double

guidanceType = 3
FWControl = struct(transitionRadius=10)

RotorCtrlBus = Simulink.Bus()
  w1: double
  w2: double
  w3: double
  w4: double
  c1: double

states = Simulink.Bus()
  pose: double[4 1]
  states: Bus: GuidanceStates
  ground: double

pose = Simulink.Bus()
  x: double
  y: double
  z: double
  yaw: double

plan = Simulink.Bus()
  mode: uint8
  ToWP: Bus: UAVPathManagerBus
  FromWP: Bus: UAVPathManagerBus

flightState = enum(DefaultValue="Hover")
  Hover = 0
  Transition = 1
  FixedWing = 2
  BackTransition = 3

Vt = 10

RC = Simulink.Bus()
  roll: double
  pitch: double
  yaw: double
  throttle: double
  trigger: double
  arm: double

flightmode = Simulink.Bus()
  HoverSP: Bus: HoverSPBus
  FixedWingSP: Bus: FixedWingCommandBus
  AACSP: Bus: AAC
  controlMode: Bus: controlMode
  FlightMode: Enum: flightState
  Status: uint8

w_trim = 104.7
FWTrimSpeed = 261.8

UAVPathManagerBus = Simulink.Bus()
  mode: uint8
  position: double[3 1]
  params: double[4 1]

yGround = 0
xGround = 0
vIni = 0
iniRoll = 0
initPitch = 0
iniYaw = 0

uavParam = struct(
  aero=struct(
    rho=1.225,
    CL0=0.8186,
    CLa=4.0913,
    CLa_dot=0,
    CLq=7.311,
    CLDe=0.5079,
    CLDa=-0.8529,
    CDmin=0.0605,
    K=0.1328,
    CL_CDmin=0.4806,
    A1=0,
    CdDe=0.016,
    CdDa=0.0921,
    CdDr=0.0097,
    Cm0=0.0076,
    Cma=-1.7697,
    Cmq=-19.2266,
    CmDe=-1.8375,
    CYb=-0.0016,
    CYp=-0.0016,
    CYr=0.1837,
    CYDr=0.1289,
    Clb=-0.0016,
    Clp=-0.4758,
    Clr=0.2715,
    ClDa=0.2866,
    ClDr=0.0134,
    Cnb=0.0918,
    Cnp=-0.1327,
    Cnr=-0.0883,
    CnDa=0.0049,
    CnDr=-0.067,
    dragCoeffMov=0.027,
    g=9.806),
  geom=struct(
    b=15.704,
    AR=19.53,
    c=1.244,
    e=12.63,
    RotorArm1=[3.041 2.591 0.137],
    RotorArm2=[3.041 -2.591 0.137],
    RotorArm3=[-3.041 -2.591 0.137],
    RotorArm4=[-3.041 2.591 0.137],
    Ixx=5970.6,
    Iyy=11196.4,
    Izz=13814,
    mass=2574.5,
    PropDiameter=3.81,
    RotorArm5=[-4.9378 0 0.3048]),
  motor=struct(RPMMAX=10000, tilt_trim=0))

control = struct(
  turningRadius=60,
  L1=60,
  transitionRadius=60,
  minThrottle=0,
  maxThrottle=1,
  slewRateThrottle=1,
  slewRateServos=5,
  maxPitch=0.1745329,
  minPitch=-0.1745329,
  maxRoll=0.6981317,
  minRoll=-0.6981317,
  maxRollRate=1.22173,
  minRollRate=-1.22173,
  maxPitchRate=1.22173,
  minPitchRate=-1.22173,
  maxClimbRate=3,
  maxDescendRate=-3,
  stallSpeed=9.5,
  cruiseSpeed=55,
  takeoffSpeed=12.35,
  takeoffNavAlt=5,
  climboutAltMin=10,
  climboutAlt=13,
  landingApproachSpeed=12.35,
  flarePitch=0.03490659,
  flareAlt=2,
  landStopVel=1,
  finalLoiterSpeed=15)

FWControlParams = struct(
  P_CLIMBRATE=0.1,
  P_ALT=0.4,
  P_AIRSPD=10,
  I_AIRSPD=0,
  D_AIRSPD=0,
  N_AIRSPD=100,
  P_FW_ROLL=2,
  P_FW_PITCH=10,
  I_FW_PITCH=0,
  D_FW_PITCH=0,
  N_FW_PITCH=2.1893,
  P_FW_ROLLRATE=0.4,
  I_FW_ROLLRATE=0.8,
  P_FW_PITCHRATE=0.15,
  P_FW_YAWRATE=0.01)

Sig = Simulink.Signal()

controller = Simulink.Bus()
  MotorActuatorCommands: Bus: FCCData
  CtrlSurfaceCommands: Bus: FixedWingCtrlBus
  a: double

MultirotorGuidanceStateBus = Simulink.Bus()
  WorldPosition: double[3 1]
  WorldVelocity: double[3 1]
  EulerZYX: double[3 1]
  BodyAngularRateRPY: double[3 1]
  Thrust: double

MultirotorGuidanceControlBus = Simulink.Bus()
  Roll: double
  Pitch: double
  YawRate: double
  Thrust: double

MultirotorGuidanceEnvironmentBus = Simulink.Bus()
  Gravity: double

GNCplan = Simulink.Bus()
  mode: uint8
  ToWP: Bus: UAVPathManagerBus
  FromWP: Bus: UAVPathManagerBus
  pose: double[4 1]
  states: Bus: GuidanceStates
  ground: double

sensorData = Simulink.Bus()
  GPSCourse: double
  gndspeed: double
  airspeed: double
  LLA: double[1 3]
  Abb: double[1 3]
  Gyro: double[1 3]
  Mag: double[1 3]
  q: double[1 4]
  GPSVelocity: double[1 3]
  Abe: double[1 3]
  YPR: double[3 1]
  RotorParameters: Bus: RotorParameters
  RC: double[1 10]
  target: single[1 3]
  arming: double

StateBus = Simulink.Bus()
  course: double
  gndspeed: double
  airspeed: double
  Xe: double[3 1]
  Ve: double[3 1]
  DCMbe: double[3 3]
  q: double[1 4]
  pqr: double[1 3]
  Vb: double[1 3]
  Abb: double[1 3]
  Abe: double[1 3]
  Euler: double[3 1]
  RotorParameters: Bus: RotorParameters
  YPR: double[3 1]
  Ve_ground: double[3 1]
  RC: double[1 10]
  target: double[1 3]

GuidanceStates = Simulink.Bus()
  Euler: double[3]
  pqr: double[3]
  Ve: double[3]
  Xe: double[3]
  course: double
  RotorParameters: Bus: RotorParameters
  RC: double[1 10]
  target: double[1 3]

controlMode = Simulink.Bus()
  lateralGuidance: uint8
  airspeedAltitude: uint8
  attitude: uint8
  manual: uint8
  armed: uint8
  inTransition: uint8
  TransitionCondition: uint8
  TransitionStep: uint8
  BackTransitionCondition: uint8
  land: double
  spoolup_active: double
  ramp_progress: double

FCCData = Simulink.Bus()
  roll: double
  pitch: double
  yaw: double
  altitude: double
  target_roll: single
  target_pitch: single
  target_yaw: single
  target_alt: single
  latitude: double
  longitude: double
  dist_n: single
  dist_e: single
  dist_d: single
  gps_num_sv: uint8
  roll_rate: single
  pitch_rate: single
  yaw_rate: single
  acc_x: double
  acc_y: double
  acc_z: double
  pressure: double
  vel_n: double
  vel_e: double
  vel_d: double
  gndspeed: double
  target_x: single
  target_y: single
  target_z: single
  gyro_x: double
  gyro_y: double
  gyro_z: double
  mag_x: double
  mag_y: double
  mag_z: double
  lin_acc_ecef_x: double
  lin_acc_ecef_y: double
  lin_acc_ecef_z: double
  q: double[4]
  airspeed: double
  voltage: int16
  current: int16
  soc: int16
  temperature: int16
  soh: int16
  gcs_link: uint8
  rc_link: uint8
  flight_mode: uint8
  m: double[6]
  rc: double[16]
  rpy_sp: double[3]
  z: double[2]
  raw_acc_x: double
  raw_acc_y: double
  raw_acc_z: double
  raw_gyro_x: double
  raw_gyro_y: double
  raw_gyro_z: double
  raw_gps_lat: double
  raw_gps_lon: double
  raw_gps_alt: double
  raw_vel_n: double
  raw_vel_e: double
  raw_vel_d: double
  baro_alt: double
  gps_fix: uint8
  gps_valid: uint8
  baro_valid: uint8

TransitionMission = [struct(mode=1, position=[0; 0; -1], params=[0; 0; 0; 0]), struct(mode=2, position=[0.3; 0; -1], params=[0; 0; 0; 0]), struct(mode=4, position=[0.3; 0; 0], params=[0; 0; 0; 0]), struct(mode=2, position=[0; 0; 0], params=[0; 0; 0; 0]), struct(mode=2, position=[0; 0; 0], params=[0; 0; 0; 0]), struct(mode=6, position=[0; 0; 0], params=[0; 0; 0; 0]), struct(mode=2, position=[0; 0; 0], params=[0; 0; 0; 0]), struct(mode=2, position=[0; 0; 0], params=[0; 0; 0; 0]), struct(mode=2, position=[0; 0; 0], params=[0; 0; 0; 0]), struct(mode=4, position=[0; 0; 0], params=[0; 0; 0; 0])]

controlParams = struct(
  P_ROLL_RATE=0.1,
  D_ROLL_RATE=0.00302,
  N_ROLL_RATE=100,
  P_PITCH_RATE=0.1,
  D_PITCH_RATE=0.00302,
  N_PITCH_RATE=100,
  P_YAW_RATE=0.6,
  D_YAW_RATE=0.1,
  N_YAW_RATE=100,
  P_ROLL=9,
  P_PITCH=9,
  P_YAW=7.2,
  P_VX=2,
  D_VX=0.5,
  N_VX=4,
  P_VY=2,
  D_VY=0.5,
  N_VY=5,
  P_VZ=5,
  D_VZ=0,
  N_VZ=8.4215,
  P_X=1,
  P_Y=1,
  P_Z=1,
  P_BACK=0.1,
  RC_P_ROLL=9,
  RC_I_ROLL=0,
  RC_D_ROLL=0,
  RC_N_ROLL=100,
  RC_P_PITCH=9,
  RC_I_PITCH=0,
  RC_D_PITCH=0,
  RC_N_PITCH=100,
  RC_P_YAW=7.2,
  RC_I_YAW=0,
  RC_D_YAW=0,
  RC_N_YAW=100,
  RC_P_ROLL_RATE=0.1,
  RC_I_ROLL_RATE=0.1,
  RC_D_ROLL_RATE=0.00302,
  RC_N_ROLL_RATE=30,
  RC_P_PITCH_RATE=0.1,
  RC_I_PITCH_RATE=0.1,
  RC_D_PITCH_RATE=0.00302,
  RC_N_PITCH_RATE=30,
  RC_P_YAW_RATE=0.6,
  RC_I_YAW_RATE=0.06,
  RC_D_YAW_RATE=0.0036,
  RC_N_YAW_RATE=70,
  I_ROLL=0,
  D_ROLL=0,
  N_ROLL=100,
  I_PITCH=0,
  D_PITCH=0,
  N_PITCH=100,
  I_YAW=0,
  D_YAW=0,
  N_YAW=100,
  I_X=0,
  D_X=0,
  N_X=100,
  I_Y=0,
  D_Y=0,
  N_Y=100,
  I_Z=0,
  D_Z=0,
  N_Z=100,
  I_VY=1,
  I_VX=1,
  I_VZ=1,
  I_ROLL_RATE=0.1,
  I_PITCH_RATE=0.1,
  I_YAW_RATE=0.06)